# Grasshopper definition point_cloud.gh (Grasshopper 0.9.76)

h_cabo_sup = Slider(71, range=0..220)
largura_apoios = Slider(23, range=0..60)
n_cabos = Slider(1, range=0..8)
horiz_div = Slider(3, range=2..20)
subdiv = Slider(2, range=1..6)
deltah = Slider(19, range=2..20)
c_script = CSharpScript(Largura=largura_apoios, N_cabos=n_cabos, Altura=h_cabo_sup, delta_h=deltah, horiz_div=horiz_div, subdiv=subdiv)  # -> Debug, Cloud; inputs Largura: Double, N_cabos: Int32, Altura: Int32, delta_h: Double, horiz_div: Double, subdiv: Double
# ---------- c_script: C# ----------
    List<Point3d> Pt_cloud = new List<Point3d>(); // no programa final usar 2D array !!! [x,y,z]

    int x = 0;
    int y = 1;
    int h = 1;
    bool reverse = false;

    //#######################//
    //Tilt calc + N of rings //
    //#######################//
    double ring_z_step = (Altura) / horiz_div; // ok

    double tilt;
    tilt = (Largura * 0.5) / (Altura) * ring_z_step; //ok

    //##################//
    //main pt cloud loop//
    //##################//

    //Pts apoio
    Pt_cloud.Add(new Point3d(0, 0, 0));
    Pt_cloud.Add(new Point3d(Largura, 0, 0));
    Pt_cloud.Add(new Point3d(Largura, Largura, 0));
    Pt_cloud.Add(new Point3d(0, Largura, 0));

    for(h = 1; h <= horiz_div - 1; h++){ // ring loop

      double scale_factor = (1 - (h / horiz_div));
      double step = h * tilt;

      if(!reverse){ // x++ y++

        for(x = 0;x <= subdiv; x++){

          Pt_cloud.Add(new Point3d(step + x * (Largura / subdiv) * scale_factor, step, h * ring_z_step));

          if (x == subdiv){

            for(y = 1;y <= subdiv; y++){

              Pt_cloud.Add(new Point3d(Largura - step, step + y * (Largura / subdiv) * scale_factor, h * ring_z_step));

              if(x == subdiv && y == subdiv){reverse = true;} // start backwards loop
            }
          }
        }

      }

      if(reverse){ // x-- y--
        for(x = (int) subdiv - 1;x >= 0; x--){
          Pt_cloud.Add(new Point3d(step + x * (Largura / subdiv) * scale_factor, Largura - step, h * ring_z_step));

          if (x == 0){
            for(y = (int) subdiv - 1;y >= 1; y--){
              Pt_cloud.Add(new Point3d(step, step + y * (Largura / subdiv) * scale_factor, h * ring_z_step));


            }
          }
        }
      }

      reverse = false;
    }

    Cloud = Pt_cloud;
# ---------- end c_script ----------
split = SplitList(List=c_script.Cloud, Index=4)  # -> ListA, ListB
c_script_2 = CSharpScript(Cloud=c_script.Cloud, subdiv=subdiv, horiz_div=horiz_div)  # -> Debug, bars; inputs Cloud: list of Point3d, subdiv: Int32, horiz_div: Int32
# ---------- c_script_2: C# ----------
    List<Line> Lines = new List<Line>();
    //
    //Connect support pts
    //
    //add Lcr
    for(int i = 0; i <= 4;i++){

      if (i == 0){
        for (int j = 4;j <= 4 + subdiv;j++){
          Lines.Add(new Line(Cloud[0], Cloud[j]));
        }
        for (int j = 8 + 4 * (subdiv - 1) - 1;j >= 8 + 4 * (subdiv - 1) - subdiv;j--){
          Lines.Add(new Line(Cloud[0], Cloud[j]));
        }

      }
      if (i == 1){
        for (int j = 4;j <= 4 + 2 * subdiv;j++){
          Lines.Add(new Line(Cloud[1], Cloud[j]));
        }
      }
      if (i == 2){
        for (int j = 4 + subdiv;j <= 4 + 3 * subdiv;j++){
          Lines.Add(new Line(Cloud[2], Cloud[j]));
        }
      }
      if (i == 3){
        for (int j = 4 + subdiv * 2;j <= 4 + 4 * subdiv - 1;j++){
          Lines.Add(new Line(Cloud[3], Cloud[j]));
        }
        Lines.Add(new Line(Cloud[3], Cloud[4]));
      }
    }

    //Connect all other points
    //add Lcr nesta fase !!!
    int ring_pt = 4 + (subdiv - 1) * 4;
    //init and end pts
    for(int h = 0; h <= horiz_div - 3;h++){

      // Lado +XX
      for(int i = 4 + ring_pt * h;i < 4 + ring_pt * (h + 1);i++){//init coord.
        //lados
        if(i == 4 + ring_pt * h){//cantos
          for(int j = 4 + ring_pt * (h + 1);j <= subdiv + 4 + ring_pt * (h + 1) - 1;j++){ //-1 para nao conectar a diagonal oposta
            Lines.Add(new Line(Cloud[i], Cloud[j]));
          }
        }else if(i == 4 + ring_pt * h + subdiv){
          for(int j = 4 + ring_pt * (h + 1) + 1;j <= subdiv + 4 + ring_pt * (h + 1) - 1;j++){ //+1 para nao conectar a diagonal oposta
            Lines.Add(new Line(Cloud[i], Cloud[j])); //quando i = j-ring_pt  id bar as active(always)
          }
        }else{ //pts centrais
          if(i > 4 + ring_pt * h && i < 4 + ring_pt * h + subdiv){
            for(int j = 4 + ring_pt * (h + 1);j <= subdiv + 4 + ring_pt * (h + 1);j++){
              Lines.Add(new Line(Cloud[i], Cloud[j]));
            }
          }
        }
      }
      // Lado +YY
      for(int i = 4 + subdiv + ring_pt * h;i < 4 + subdiv + ring_pt * (h + 1);i++){//init coord.

        //lados
        if(i == 4 + subdiv + ring_pt * h){//cantos
          for(int j = 4 + subdiv + ring_pt * (h + 1);j <= 2 * subdiv + 4 + ring_pt * (h + 1) - 1;j++){
            Lines.Add(new Line(Cloud[i], Cloud[j]));
          }
        }else if(i == 4 + ring_pt * h + 2 * subdiv){
          for(int j = 4 + subdiv + ring_pt * (h + 1) + 1;j <= 2 * subdiv + 4 + ring_pt * (h + 1) - 1;j++){
            Lines.Add(new Line(Cloud[i], Cloud[j]));
          }

        }else{ //pts centrais
          if(i > 4 + subdiv + ring_pt * h && i < 4 + ring_pt * h + 2 * subdiv){
            for(int j = 4 + subdiv + ring_pt * (h + 1);j <= 2 * subdiv + 4 + ring_pt * (h + 1);j++){
              Lines.Add(new Line(Cloud[i], Cloud[j]));
            }
          }
        }
      }

      // Lado -XX
      for(int i = 4 + 2 * subdiv + ring_pt * h;i < 4 + 2 * subdiv + ring_pt * (h + 1);i++){//init coord.
        //lados
        if(i == 4 + 2 * subdiv + ring_pt * h){//cantos
          for(int j = 4 + 2 * subdiv + ring_pt * (h + 1);j <= 3 * subdiv + 4 + ring_pt * (h + 1) - 1;j++){
            Lines.Add(new Line(Cloud[i], Cloud[j]));
          }
        }else if(i == 4 + ring_pt * h + 3 * subdiv){
          for(int j = 4 + 2 * subdiv + ring_pt * (h + 1) + 1;j <= 3 * subdiv + 4 + ring_pt * (h + 1) - 1;j++){
            Lines.Add(new Line(Cloud[i], Cloud[j]));
          }
        }else{ //pts centrais
          if(i > 4 + 2 * subdiv + ring_pt * h && i < 4 + ring_pt * h + 3 * subdiv){
            for(int j = 4 + 2 * subdiv + ring_pt * (h + 1);j <= 3 * subdiv + 4 + ring_pt * (h + 1);j++){
              Lines.Add(new Line(Cloud[i], Cloud[j]));
            }
          }
        }
      }

      // Lado -YY
      for(int i = 4 + 3 * subdiv + ring_pt * h;i < 4 + 3 * subdiv + ring_pt * (h + 1);i++){//init coord.
        //lados
        if(i == 4 + 3 * subdiv + ring_pt * h){//cantos
          for(int j = 4 + 3 * subdiv + ring_pt * (h + 1);j <= 4 * subdiv + 4 + ring_pt * (h + 1) - 1;j++){
            Lines.Add(new Line(Cloud[i], Cloud[j]));

            if(j != 4 + 3 * subdiv + ring_pt * (h + 1) ){ //exceto lado oposto
              Lines.Add(new Line(Cloud[4 + ring_pt * h], Cloud[j]));
            } //conect first corner w/ side -YY

          }
        }else{ //pts centrais
          if(i > 4 + 3 * subdiv + ring_pt * h && i < 4 + ring_pt * h + 4 * subdiv){
            for(int j = 4 + 3 * subdiv + ring_pt * (h + 1);j <= 4 * subdiv + 4 + ring_pt * (h + 1) - 1;j++){
              Lines.Add(new Line(Cloud[i], Cloud[j]));
            }
            Lines.Add(new Line(Cloud[i], Cloud[4 + ring_pt * (h + 1)])); //conect to init pt
          }
        }
      }

    }

    // Horizontal connections
    //add Lcr nesta fase!!!
    for(int h = 0; h <= horiz_div - 2;h++){
      for(int i = 4 + h * ring_pt;i < 4 + (h +1) * ring_pt - 1;i++){
        Lines.Add(new Line(Cloud[i], Cloud[i + 1]));
        if(i == 4 + (h + 1 ) * ring_pt - 2){
          Lines.Add(new Line(Cloud[i+1], Cloud[4 + h * ring_pt]));
        }
      }
    }

    //
    bars = Lines;
# ---------- end c_script_2 ----------
ln = Line(StartPoint=graft(split.ListA), EndPoint=split.ListB)  # disabled
panel = Panel(c_script.Cloud)
panel_2 = Panel(c_script_2.bars)
